# Grasshopper definition 1_build_site_model.gh (Grasshopper 1.0.8)
# plug-ins: Urbano2

workflow_template = WorkflowTemplate()  # -> Directories, Templates
python_3_script = Python3Script(x=workflow_template.Directories)  # -> out, a
# ---------- python_3_script: Python ----------
import json
import os

json_string = """
{
  "Folder": "folder",
  "FileNameStr": "40.7167_40.6998_-74_-74.0234",
  "Granularity": "Block",
  "CoordinateReference": {
    "Utm": "18T",
    "BottomLeftUtm": {
      "Item1": 582505.6826406379,
      "Item2": 4505891.429438546
    },
    "BottomRightUtm": {
      "Item1": 584482.6049859334,
      "Item2": 4505913.668196009
    }
  }, 
  "Top": 40.7167,
  "Bottom": 40.6998,
  "Left": -74.0234,
  "Right": -74,
  "OsmFilePath": "40.7167_40.6998_-74_-74.0234.osm.pbf",
  "BlockFilePath": "40.7167_40.6998_-74_-74.0234.blocks",
  "ElevationFilePath": "40.7167_40.6998_-74_-74.0234.egrid",
  "OvertureFilePath": "",
  "Layers": []
}
"""

def update_folder_and_filepaths(json_str: str, x: str) -> str:
    data = json.loads(json_str)
    data["Folder"] = x

    def walk(obj):
        if isinstance(obj, dict):
            for k, v in obj.items():
                if isinstance(v, str) and k.endswith("FilePath") and v.strip():
                    obj[k] = os.path.join(x, os.path.basename(v))
                else:
                    walk(v)
        elif isinstance(obj, list):
            for item in obj:
                walk(item)

    walk(data)
    return json.dumps(data, indent=2)

# usage
a = update_folder_and_filepaths(json_string, x)
print(a)
# ---------- end python_3_script ----------
# Example string
panel = Panel(python_3_script.a)
# Click this button to
# start generating your own
# project setting string
project_setting = ProjectSetting()
# Replace with your
# generated string
text = Text(panel)
import_public_transits = ImportPublicTransits(ProjectSetting=text, DataSource="osm", Terrain=True)  # -> TransitLines, TransitStops
import_green_spaces = ImportGreenSpaces(ProjectSetting=text, DataSource="osm", Terrain=True)  # -> GreenSpaces, Trees
import_streets = ImportStreets(ProjectSetting=text, DataSource="osm", Terrain=True)
import_terrain = ImportTerrain(ProjectSetting=text, Colored=True)
import_buildings = ImportBuildings(ProjectSetting=text, DataSource="osm", Terrain=True)  # -> _2DFootprints, _3DMeshes
