# Grasshopper definition 2_custom_import_osm_data.gh (Grasshopper 1.0.8)
# plug-ins: Urbano2

# Select from dropdown
# or input your own query
osm_feature_query = OsmFeatureQuery(OsmFeatureQuery="(parking)")
workflow_template = WorkflowTemplate()  # -> Directories, Templates
# Path to example file
python_3_script = Python3Script(x=workflow_template.Directories, y="40.7167_40.6998_-74_-74.0234.osm.pbf")  # -> out, a
# ---------- python_3_script: Python ----------
import os

a = os.path.join(x,y)
# ---------- end python_3_script ----------
panel = Panel(osm_feature_query)
import_osm_file = ImportOSMFile(OsmFilePath=python_3_script.a, OsmFeatures=panel, Terrain=False, Run=True)  # -> Polylines, Polygons, Points, CoordinateReference, Boundary
