# Grasshopper definition 4_import_geojson.gh (Grasshopper 1.0.8)
# plug-ins: Urbano2

workflow_template = WorkflowTemplate()  # -> Directories, Templates, ExampleProjectSetting, ExampleOSMFilePath, ExampleShapefilePath, ExampleGeojsonPath
geographic_boundary = GeographicBoundary(Left="-74.023399", Top="40.716702", Right="-74", Bottom="40.699799")  # -> Boundary, CoordinateReference
import_geojson_file = ImportGeojsonFile(
    GeojsonFilePath=workflow_template.ExampleGeojsonPath,
    CroppingBoundary=geographic_boundary.Boundary,
    Terrain=False,
    Run=True)  # -> Polylines, Polygons, Points, CoordinateReference, Boundary
