# Grasshopper definition 2_compute_walkscore_by_block.gh (Grasshopper 1.0.8)
# plug-ins: Urbano2

workflow_template = WorkflowTemplate()  # -> Directories, Templates, ExampleProjectSetting, ExampleOSMFilePath, ExampleShapefilePath, ExampleGeojsonPath
deconstruct_project_setting = DeconstructProjectSetting(ProjectSetting=workflow_template.ExampleProjectSetting)  # -> Directory, Boundary, Granularity, DataLayers, DataFiles, CoordinateReference
import_data_blocks = ImportDataBlocks(ProjectSetting=workflow_template.ExampleProjectSetting, DataSource="urbano synthesized", Terrain=False)

# ----
# Compute Walkscore for input geometries
button = Button()
walkscore_component = WalkscoreComponent(
    OSMFilePath=workflow_template.ExampleOSMFilePath,
    Geometries=import_data_blocks,
    CoordinateReference=deconstruct_project_setting.CoordinateReference,
    Run=button,
    WalkscoreCachedScores_0=93.61446158,
    WalkscoreCachedScores_1=94.80777989,
    WalkscoreCachedScores_10=91.65459624,
    WalkscoreCachedScores_100=98.87441873,
    WalkscoreCachedScores_101=88.62885143,
    WalkscoreCachedScores_102=87.63013122,
    WalkscoreCachedScores_103=93.03700949,
    WalkscoreCachedScores_104=96.47955449,
    WalkscoreCachedScores_105=94.68779509,
    WalkscoreCachedScores_106=96.78783145,
    WalkscoreCachedScores_107=98.69200201,
    WalkscoreCachedScores_108=94.09482205,
    WalkscoreCachedScores_109=95.38064477,
    WalkscoreCachedScores_11=79.36024537,
    WalkscoreCachedScores_110=96.20289237,
    WalkscoreCachedScores_111=93.1002116,
    WalkscoreCachedScores_112=96.9583611,
    WalkscoreCachedScores_113=93.09734114,
    WalkscoreCachedScores_114=92.80719895,
    WalkscoreCachedScores_115=91.84646815,
    WalkscoreCachedScores_116=94.03946281,
    WalkscoreCachedScores_117=96.87675862,
    WalkscoreCachedScores_118=97.53948701,
    WalkscoreCachedScores_119=94.43725523,
    WalkscoreCachedScores_12=97.09729496,
    WalkscoreCachedScores_120=96.53397911,
    WalkscoreCachedScores_121=85.00936418,
    WalkscoreCachedScores_122=92.32677936,
    WalkscoreCachedScores_123=92.78428852,
    WalkscoreCachedScores_124=93.68221772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)  # -> Geometries, Walkscores

urbano_gradient = UrbanoGradient(
    Reverse=False,
    stops=[0: RGB(75, 107, 169), 0.25: RGB(173, 203, 249), 0.5: RGB(254, 244, 84), 0.75: RGB(234, 126, 0), 1: RGB(234, 38, 0)])
map_settings = MapSettings(Gradient=urbano_gradient, Max="100", Min=Slider(85, range=50..100), Legend=True, LegendTitle="Walkscore", Label=False)
surface = Surface(walkscore_component.Geometries)
draw_map = DrawMap(Geometries=surface, Values=walkscore_component.Walkscores, MapSettings=map_settings)
